# Grasshopper definition Toolpaths.gh (Grasshopper 1.0.7)
# plug-ins: ClipperComponents, Pufferfish, Shortest Walk in Gh, Kangaroo Components, Kangaroo2 Components, EleFront, Anemone

# ----
# Toolpath Generation
# Refer to Geometry
# In this tutorial toolpaths are generated from a cellular geometry with the aim of 3D printing. Single curves are created for each printing layer, which will be connected in a consecutive script. This will eventually result in a single continuous toolpath.
# The toggle 'Run' (at the start of the first loop) needs to be set to true in order to run the script.
# Orient the geometry in Rhino to the XY-plane. The Z-axis will become the printing direction. If the geometry does not contain a flat which can be placed on the printing bed, it can be split in two. One part can be printed in the designated direction, the other can be rotate 180 degrees. These preparations need to be done in Rhino and - if necessary - the toolpaths for the split part need to be generated seperately. After these preperations a volume (box) needs to be drawn around the geometry (each part individually) which will be used in Grasshopper to define the printing bed and direction
pipeline = GeometryPipeline(
    GroupByLayer=False,
    GroupByType=False,
    IncludeHidden=True,
    IncludeLocked=True,
    LayerFilter="Fragment::Voronoi Structure::Cells*",
    NameFilter="*",
    SublayerFiltering=True,
    TypeFilter=32)
pipeline_2 = GeometryPipeline(
    GroupByLayer=False,
    GroupByType=False,
    IncludeHidden=True,
    IncludeLocked=True,
    LayerFilter="Fragment::Print Volume",
    NameFilter="*",
    SublayerFiltering=True,
    TypeFilter=32)

# ----
# Print Settings
layer_height = Slider(10, range=0..140)
layer_width = Slider(4, range=0..40)

# ----
# Print Bed and Direction
demesh = DeconstructMesh(Mesh=pipeline_2)  # -> Vertices, Faces, Colours, Normals
avr = Average(Input=demesh.Vertices)
# Describe the print bed. It is the XY-plane at the lowest point of the geometry.
pdecon = Deconstruct(Point=demesh.Vertices)  # -> XComponent, YComponent, ZComponent
sort = SortList(Keys=pdecon.ZComponent, ValuesA=demesh.Vertices)  # -> Keys, ValuesA
item = ListItem(List=sort.ValuesA, Index=0, Wrap=True)
xy = XYPlane(Origin=item)
project = Project(Geometry=avr, Plane=xy)  # -> Geometry, Transform
Z = UnitZ(Factor=expr("-x/2", layer_height))
xy_2 = XYPlane(Origin=project.Geometry)
move = Move(Geometry=xy_2, Motion=Z)  # -> Geometry, Transform
deplane = DeconstructPlane(Plane=move.Geometry)  # -> Origin, XAxis, YAxis, ZAxis

# ----
# Contours
contour = Contour(Shape=pipeline, Point=move.Geometry, Direction=deplane.ZAxis, Distance=layer_height)  # -> simplify(Contours)
join = JoinCurves(Curves=flatten(contour), Preserve=False)

# ----
# Order in Paths
pcen = PolygonCenter(Polyline=join)  # -> CenterV, CenterE, CenterA
pdecon_2 = Deconstruct(Point=pcen.CenterV)  # -> XComponent, YComponent, ZComponent
sort_2 = SortList(Keys=pdecon_2.ZComponent, ValuesA=join)  # -> Keys, ValuesA
# Sort the curves according to elevation and order them into branches.
round = Round(Number=sort_2.Keys)  # -> Nearest, Floor, Ceiling
reldif = RelativeDifferences(Values=round.Nearest)
equals = Equality(FirstNumber=reldif, SecondNumber=0)  # -> Equality, Inequality
mindex = MemberIndex(Set=equals.Inequality, Member=True)  # -> Index, Count
ins = InsertItems(List=mindex.Index, Item=0, Indices=0, Wrap=True)
lng = ListLength(List=join)
ins_2 = InsertItems(List=ins, Item=lng, Indices=-1, Wrap=True)
reldif_2 = RelativeDifferences(Values=ins_2)
cull_i = CullIndex(List=reldif_2, Indices=0, Wrap=True)
partition = PartitionList(List=sort_2.ValuesA, Size=cull_i)  # -> simplify(Chunks)
lng_2 = ListLength(List=cull_i)  # -> expr("x-1", Length)

run = BooleanToggle(False)

# ----
# Offset Curves and Connect Cells
# Offset the curves and cull the small and narrow ones.
# Create curves which are closed, non-selfintersecting etc.
# A diagram is generated which determines which cell edges need to be trimmed and connected to the neighbour. The diagram connects all cells to the exterior curve, without enclosing any regions. Connecting the cells assigned by the diagram will result in a single continuous curve.
# From the diagram the correct edges need to be selected. It should be ensured that the same edges from neighbouring cells are selected. To do this the most perpendicular lines from multiple lines in proximity are selected. If these are similar the longest is selected.
# Trimming regions are created from the mid-point of the selected lines. These are used to trim the curves. The resulting single curve is placed in a tree branch corresponding to the layer. Not all situations are solved in this phase.
number_slider = Slider(0, range=0..100)

filter = StreamFilter(Gate=run, Stream0=number_slider, Stream1=lng_2)

loop_start = LoopStart(N=filter, T=Button(), D0=partition)  # -> port, Counter, Data, Data_2
panel = Panel(loop_start.Counter)
branch = TreeBranch(Tree=simplify(loop_start.Data), Path=loop_start.Counter, MaintainPaths=True)
crv = Curve(branch)

# ---- group: Offset
polyoffset = PolylineOffset(
    Polylines=crv,
    Distance=layer_width,
    Plane=Plane(origin=(0, 0, 0), x=(0, 0, 0), y=(0, 0, 0)),
    Tolerance=0.0001,
    ClosedFillet=1,
    OpenFillet=1,
    Miter=2)  # -> Contour, Holes
crv_2 = Curve([polyoffset.Contour, polyoffset.Holes])

# ---- group: Minimum Length and Proportions
explode = Explode(Curve=crv_2, Recursive=True)  # -> Segments, Vertices
item_2 = ListItem(List=explode.Vertices, Index=0, Wrap=True)
fline = FitLine(Points=explode.Vertices)
lnpt = LinePt(Line=fline, Point=item_2)
# Offset Contours
brec = BoundingRectangle(Geometry=graft(crv_2), Plane=lnpt, Axis=0, Slide=0, Union=True)
multiplication = Multiplication(A=layer_width, B=Slider(2, range=0..10))
drec = DeconstuctRectangle(Rectangle=brec)  # -> BasePlane, XInterval, YInterval
dedomain = DeconstructDomain(Domain=drec.XInterval)  # -> Start, End
dedomain_2 = DeconstructDomain(Domain=drec.YInterval)  # -> Start, End
subtraction = Subtraction(A=dedomain.Start, B=dedomain.End)
subtraction_2 = Subtraction(A=dedomain_2.Start, B=dedomain_2.End)
abs = Absolute(Value=subtraction)
abs_2 = Absolute(Value=subtraction_2)
larger = LargerThan(FirstNumber=abs_2, SecondNumber=multiplication)  # -> LargerThan, OrEqualTo
larger_2 = LargerThan(FirstNumber=abs, SecondNumber=multiplication)  # -> LargerThan, OrEqualTo
and = GateAnd(A=larger_2.LargerThan, B=larger.LargerThan)  # -> flatten(Result)
cull = CullPattern(List=crv_2, CullPattern=and)

# ---- group: Plane Surfaces
series = Series(Start=0, Step=layer_height, Count=1)
amp = Amplitude(Vector=deplane.ZAxis, Amplitude=series)
move_2 = Move(Geometry=move.Geometry, Motion=amp)  # -> Geometry, Transform
brec_2 = BoundingRectangle(Geometry=crv, Plane=move_2.Geometry, Axis=0, Slide=0, Union=True)
area = Area(Geometry=brec_2)  # -> Area, Centroid
# Closed Non-Overlapping Polylines
scale = Scale(Geometry=brec_2, Center=area.Centroid, Factor=1.2)  # -> Geometry, Transform
boundary = BoundarySurfaces(Edges=scale.Geometry)

# ---- group: Polylines
srfsplit = SurfaceSplit(Surface=boundary, Curves=cull)
debrep = DeconstructBrep(Brep=srfsplit)  # -> Faces, Edges, Vertices
lng_3 = ListLength(List=debrep.Vertices)
sort_3 = SortList(Keys=flatten(lng_3), ValuesA=srfsplit)  # -> Keys, ValuesA
item_3 = ListItem(List=sort_3.ValuesA, Index=-1, Wrap=True)
edges = BrepEdges(Brep=item_3)  # -> Naked, Interior, NonManifold

# ---- group: Dispatch Closed Cells
crv_3 = Curve(crv)
cls = Closed(Curve=crv_3)  # -> Closed, Periodic
dispatch = Dispatch(List=crv_3, DispatchPattern=cls.Closed)  # -> ListA, ListB

# ----
join_2 = JoinCurves(Curves=edges.Naked, Preserve=False)
crv_4 = Curve(join_2)

# ---- group: Shortest Path
len = Length(Curve=crv_4)
sort_4 = SortList(Keys=len, ValuesA=crv_4)  # -> Keys, reverse(ValuesA)
item_4 = ListItem(List=sort_4.ValuesA, Index=0, Wrap=True)
cull_i_2 = CullIndex(List=sort_4.ValuesA, Indices=0, Wrap=True)
area_2 = Area(Geometry=cull_i_2)  # -> Area, Centroid
crv_cp = CurveClosestPoint(Point=area_2.Centroid, Curve=item_4)  # -> Point, Parameter, Distance
ln = Line(StartPoint=area_2.Centroid, EndPoint=crv_cp.Point)

# ---- group: Delaunay
con = DelaunayEdges(Points=area_2.Centroid, Plane=PlaneXY(0, 0, 0))  # -> Connectivity, flatten(Edges)
dupln = RemoveDuplicateLines(Lines=con.Edges, Tolerance=0.01)
trim = TrimWithRegions(Curve=dupln, Regions=dispatch.ListA)  # -> Inside, Outside
lng_4 = ListLength(List=trim.Inside)
lng_5 = ListLength(List=trim.Outside)
smaller = SmallerThan(FirstNumber=lng_5, SecondNumber=1)  # -> SmallerThan, OrEqualTo
smaller_2 = SmallerThan(FirstNumber=lng_4, SecondNumber=3)  # -> SmallerThan, OrEqualTo
and_2 = GateAnd(A=smaller_2.SmallerThan, B=smaller.SmallerThan)
cull_2 = CullPattern(List=dupln, CullPattern=flatten(and_2))  # -> flatten(List)

# ---- group: Shortest Path (continued)
shortwalk = ShortestWalk(Curves=cull_2, WantedPath=graft(ln))  # -> ShortestWalk, Succession, Direction, Length

# ---- group: Connection to Exterior from paths
explode_2 = Explode(Curve=shortwalk.ShortestWalk, Recursive=True)  # -> Segments, Vertices
Z_2 = UnitZ(Factor=1)
dupln_2 = RemoveDuplicateLines(Lines=flatten(explode_2.Segments), Tolerance=0.01)
extr = Extrude(Base=explode_2.Segments, Direction=Z_2)
smesh = SimpleMesh(Brep=extr)  # -> flatten(Mesh)
mjoin = MeshJoin(Meshes=smesh)
disjoint = DisjointMesh(Mesh=mjoin)  # -> graft(Meshes)
demesh_2 = DeconstructMesh(Mesh=disjoint)  # -> Vertices, Faces, Colours, Normals
# Connection Diagram
crv_cp_2 = CurveClosestPoint(Point=demesh_2.Vertices, Curve=item_4)  # -> Point, Parameter, Distance
sort_5 = SortList(Keys=crv_cp_2.Distance, ValuesA=crv_cp_2.Point, ValuesB=demesh_2.Vertices)  # -> Keys, ValuesA, ValuesB
item_5 = ListItem(List=sort_5.ValuesA, Index=0, Wrap=True)
item_6 = ListItem(List=sort_5.ValuesB, Index=0, Wrap=True)
ln_2 = Line(StartPoint=item_6, EndPoint=item_5)  # -> flatten(Line)

# ---- group: Connection to Exterior from single cells
pull = PullPoint(Point=area_2.Centroid, Geometry=dupln_2, ClosestOnly=True)  # -> ClosestPoint, Distance
larger_3 = LargerThan(FirstNumber=pull.Distance, SecondNumber=1)  # -> LargerThan, OrEqualTo
cull_3 = CullPattern(List=ln, CullPattern=flatten(larger_3.LargerThan))

# ---- group: Initial Connection Diagram
merge = Merge(Data1=ln_2, Data2=cull_3)
dupln_3 = RemoveDuplicateLines(Lines=flatten(merge), Tolerance=0.01)
ext = ExtendCurve(Curve=dupln_3, Type=0, Start=0, End=5)
redpline = Reduce(Polyline=ext, Tolerance=1)  # -> Polyline, Reduction
merge_2 = Merge(Data1=dupln_2, Data3=redpline.Polyline)  # -> flatten(Result)

# ---- group: Avoid Closed Loops
boundary_2 = BoundarySurfaces(Edges=item_4)
srfsplit_2 = SurfaceSplit(Surface=boundary_2, Curves=merge_2)
area_3 = Area(Geometry=srfsplit_2)  # -> Area, Centroid
lng_6 = ListLength(List=srfsplit_2)  # -> expr("x-1", Length)
sort_6 = SortList(Keys=area_3.Area, ValuesA=area_3.Centroid)  # -> Keys, ValuesA
split = SplitList(List=sort_6.ValuesA, Index=lng_6)  # -> graft(ListA), ListB
lng_7 = ListLength(List=merge_2)
crv_cp_3 = CurveClosestPoint(Point=split.ListA, Curve=merge_2)  # -> Point, Parameter, Distance
series_2 = Series(Start=0, Step=1, Count=lng_7)
sort_7 = SortList(Keys=crv_cp_3.Distance, ValuesA=series_2)  # -> Keys, ValuesA
item_7 = ListItem(List=sort_7.ValuesA, Index=0, Wrap=True)  # -> flatten(Item)
cset = CreateSet(List=item_7)  # -> Set, Map
cull_i_3 = CullIndex(List=merge_2, Indices=cset.Set, Wrap=True)

# ---- group: Refer to closed Voronoi Cells
explode_3 = Explode(Curve=cull_i_3, Recursive=True)  # -> Segments, Vertices
incurves = PointInCurves(Point=explode_3.Vertices, Curves=dispatch.ListA)  # -> Relationship, graft(Index), Point
item_8 = ListItem(List=dispatch.ListA, Index=incurves.Index, Wrap=True)
number_slider_2 = Slider(1, range=0..30)
lng_8 = ListLength(List=explode_3.Vertices)
dup = DuplicateData(Data=explode_3.Segments, Number=lng_8, Order=True)  # -> graft(Data)

# ---- group: Refer to open Voronoi Cells
graft = GraftParallel(PrimaryData=explode_3.Vertices, SecondaryData1=explode_3.Segments)  # -> PrimaryData, flatten(SecondaryData1)
trim_2 = TrimWithRegions(Curve=graft.SecondaryData1, Regions=dispatch.ListA)  # -> Inside, Outside
crv_5 = Curve(dispatch.ListB)
merge_3 = Merge(Data1=trim_2.Inside, Data2=trim_2.Outside)
explode_4 = Explode(Curve=crv_5, Recursive=True)  # -> flatten(Segments), Vertices
lng_9 = ListLength(List=merge_3)
smaller_3 = SmallerThan(FirstNumber=lng_9, SecondNumber=3)  # -> flatten(SmallerThan), OrEqualTo
equals_2 = Equality(FirstNumber=incurves.Index, SecondNumber=-1)  # -> flatten(Equality), Inequality
and_3 = GateAnd(A=equals_2.Equality, B=smaller_3.SmallerThan)
ext_2 = ExtendCurve(Curve=explode_4.Segments, Type=0, Start=number_slider_2, End=number_slider_2)  # -> simplify(Curve)
cull_4 = CullPattern(List=graft.SecondaryData1, CullPattern=and_3)  # -> flatten(List)
Z_3 = UnitZ(Factor=1)
extr_2 = Extrude(Base=ext_2, Direction=Z_3)
extr_3 = Extrude(Base=cull_4, Direction=Z_3)
smesh_2 = SimpleMesh(Brep=extr_2)
smesh_3 = SimpleMesh(Brep=extr_3)
clash = Clash(FirstSet=smesh_2, SecondSet=smesh_3, Distance=0, L=100)  # -> ClashCount, ClashPoints, ClashRadii, FirstIndex, SecondIndex

# ----
# Select Connecting Edges
boundary_3 = BoundarySurfaces(Edges=item_8)
edges_2 = BrepEdges(Brep=boundary_3)  # -> Naked, Interior, NonManifold
join_3 = JoinCurves(Curves=edges_2.Naked, Preserve=False)

# ---- group: Refer to closed Voronoi Cells (continued)
explode_5 = Explode(Curve=join_3, Recursive=True)  # -> Segments, Vertices
ext_3 = ExtendCurve(Curve=explode_5.Segments, Type=0, Start=number_slider_2, End=number_slider_2)  # -> simplify(Curve)
lng_10 = ListLength(List=ext_3)
dup_2 = DuplicateData(Data=dup, Number=lng_10, Order=True)  # -> graft(Data)

# ---- group: Refer to open Voronoi Cells (continued)
cluster = Cluster(L=cull_4, i=clash.SecondIndex, I=clash.SecondIndex, T=ext_3)
cluster_2 = Cluster(L=ext_2, i=clash.FirstIndex, I=clash.SecondIndex, T=ext_3)
cluster_3 = Cluster(L=explode_4.Segments, i=clash.FirstIndex, I=clash.SecondIndex, T=ext_3)
path_mapper = PathMapper(cluster, source="{A}(i)", target="{A;0;i}")
path_mapper_2 = PathMapper(cluster_2, source="{A}(i)", target="{A;0;i}")
path_mapper_3 = PathMapper(cluster_3, source="{A}(i)", target="{A;0;i}")

# ---- group: Extended Voronoi Cells
merge_4 = Merge(Data1=simplify(graft(ext_3)), Data2=path_mapper_2)

# ---- group: Voronoi Cells
merge_5 = Merge(Data1=simplify(graft(explode_5.Segments)), Data2=path_mapper_3)

# ---- group: Diagram
merge_6 = Merge(Data1=simplify(dup_2), Data2=path_mapper)

# ----
ccx = CurveCurve(CurveA=merge_6, CurveB=merge_4)  # -> Points, ParamsA, ParamsB

# ---- group: Select most orthogonal Edges
eval = EvaluateCurve(Curve=graft(merge_4), Parameter=ccx.ParamsB)  # -> Point, simplify(Tangent), Angle
eval_2 = EvaluateCurve(Curve=merge_6, Parameter=ccx.ParamsA)  # -> Point, Tangent, Angle
trim_3 = TrimTree(Tree=simplify(eval_2.Tangent), Depth=1)
trim_4 = TrimTree(Tree=simplify(eval.Tangent), Depth=1)
vrot = Rotate(Vector=trim_4, Axis=Z_2, Angle=1.570796327)
neg = Negative(Value=vrot)
angle = Angle(VectorA=trim_3, VectorB=vrot)  # -> Angle, Reflex
angle_2 = Angle(VectorA=trim_3, VectorB=neg)  # -> Angle, Reflex
max = Maximum(A=angle.Angle, B=angle_2.Angle)
lng_11 = ListLength(List=max)
series_3 = Series(Start=0, Step=1, Count=lng_11)
sort_8 = SortList(Keys=max, ValuesA=series_3)  # -> Keys, reverse(ValuesA)
item_9 = ListItem(List=sort_8.Keys, Index=0, Wrap=True)
similar = Similarity(FirstNumber=sort_8.Keys, SecondNumber=item_9, Threshold=0.1)  # -> Similarity, AbsoluteDifference
cull_5 = CullPattern(List=sort_8.ValuesA, CullPattern=similar.Similarity)

# ---- group: Select intersected Voronoi Edges
lng_12 = ListLength(List=eval.Point)
equals_3 = Equality(FirstNumber=lng_12, SecondNumber=1)  # -> Equality, Inequality
cull_6 = CullPattern(List=merge_5, CullPattern=equals_3.Equality)
trim_5 = TrimTree(Tree=simplify(cull_6), Depth=1)

# ---- group: Select most orthogonal Edges (continued)
item_10 = ListItem(List=trim_5, Index=cull_5, Wrap=True)

# ---- group: Select Longest Edge
len_2 = Length(Curve=item_10)
sort_9 = SortList(Keys=len_2, ValuesA=item_10)  # -> Keys, reverse(ValuesA)
equals_4 = Equality(FirstNumber=lng_11, SecondNumber=0)  # -> Equality, Inequality
item_11 = ListItem(List=sort_9.ValuesA, Index=0, Wrap=True)
cull_7 = CullPattern(List=item_11, CullPattern=equals_4.Inequality)

# ----
dupln_4 = RemoveDuplicateLines(Lines=flatten(cull_7), Tolerance=0.1)

# ---- group: Trim Regions
eval_3 = EvaluateCurve(Curve=reparameterize(dupln_4), Parameter=0.5)  # -> Point, Tangent, Angle
Z_4 = UnitZ(Factor=1)
pl = PlaneNormal(Origin=eval_3.Point, ZAxis=Z_4)
deplane_2 = DeconstructPlane(Plane=pl)  # -> Origin, XAxis, YAxis, ZAxis
angle_3 = Angle(VectorA=deplane_2.XAxis, VectorB=eval_3.Tangent, Plane=pl)  # -> Angle, Reflex
prot = RotatePlane(Plane=pl, Angle=angle_3.Angle)
dom = ConstructDomain(DomainStart=expr("-x*3", layer_width), DomainEnd=expr("x*3", layer_width))
dom_2 = ConstructDomain(DomainStart=expr("-x", layer_width), DomainEnd=layer_width)
rectangle = Rectangle(Plane=prot, XSize=dom_2, YSize=dom, Radius=layer_width)  # -> flatten(Rectangle), Length
runion = RegionUnion(Curves=rectangle.Rectangle)

# ---- group: Trim
# Continuous Toolpath
trim_6 = TrimWithRegions(Curve=crv_4, Regions=runion)  # -> Inside, Outside
trim_7 = TrimWithRegions(Curve=runion, Regions=cull_i_2)  # -> Inside, Outside
trim_8 = TrimWithRegions(Curve=trim_7.Outside, Regions=item_4)  # -> Inside, Outside
trim_9 = TrimTree(Tree=simplify(trim_8.Inside), Depth=1)
end = EndPoints(Curve=trim_9)  # -> Start, End
ln_3 = Line(StartPoint=end.Start, EndPoint=end.End)
merge_7 = Merge(Data1=simplify(trim_6.Outside), Data2=simplify(ln_3))
join_4 = JoinCurves(Curves=flatten(merge_7), Preserve=False)

# ---- group: Assign Data Tree Path
tstat = TreeStatistics(Tree=join_4)  # -> Paths, Length, Count
path = ConstructPath(Indices=loop_start.Counter)
replace = ReplacePaths(Data=join_4, Search=tstat.Paths, Replace=path)

# ----
merge_8 = Merge(Data1=loop_start.Data_2, Data2=replace)
clean = CleanTree(RemoveNulls=True, RemoveInvalid=True, RemoveEmpty=False, Tree=merge_8)
loop_end = LoopEnd(
    port=loop_start.port,
    Exit=False,
    Data=simplify(loop_start.Data),
    Data_2=clean,
    TimeOutVal=0,
    pausedState=False,
    state="Output last")  # -> D0, D1

# ----
# Close and Cull too Short
clean_2 = CleanTree(RemoveNulls=True, RemoveInvalid=True, RemoveEmpty=True, Tree=loop_end.D1)
num = Number(layer_width)
clscrv = CloseCurve(Curve=clean_2, CloseType=0, Bulge=0.5, Tolerance=expr("x*6", num))  # -> Closed, R
len_3 = Length(Curve=clscrv.Closed)
smaller_4 = SmallerThan(FirstNumber=len_3, SecondNumber=expr("x*12", num))  # -> SmallerThan, OrEqualTo
cull_8 = CullPattern(List=clscrv.Closed, CullPattern=invert(smaller_4.SmallerThan))

viewer = ParamViewer(loop_end.D1)

# ----
# Final Fix
# Select the current layer and check whether it contains a single curve or not. If so, the loop can proceed to the next iteration. If not, it needs some adjustments.
# The intersection points are sorted and optional lines are generated. From these lines the most similar to the existing lines are culled. This leaves the lines connecting the two curves.
# The remaining issues are only locally. Therefore there is one main curve on which the other(s) need to be connected. Split the list in the main curve on one hand and the rest on the other. Calculate the proximity from the curves to the main.
# Define the regions to trim the curves with.
# Join the trimmed curves and connecting lines
crv_6 = Curve(cull_8)
number_slider_3 = Slider(68, range=0..100)
tstat_2 = TreeStatistics(Tree=crv_6)  # -> Paths, Length, Count
lng_13 = ListLength(List=tstat_2.Paths)  # -> expr("x-1", Length)
viewer_2 = ParamViewer(crv_6)
loop_start_2 = LoopStart(N=lng_13, T=Button(), D0=simplify(crv_6))  # -> port, Counter, Data, Data_2
panel_2 = Panel(loop_start_2.Counter)

# ----
# Select and Check
tstat_3 = TreeStatistics(Tree=loop_start_2.Data)  # -> Paths, Length, Count
item_12 = ListItem(List=tstat_3.Paths, Index=loop_start_2.Counter, Wrap=False)
branch_2 = TreeBranch(Tree=simplify(loop_start_2.Data), Path=item_12, MaintainPaths=True)
lng_14 = ListLength(List=branch_2)
larger_4 = LargerThan(FirstNumber=lng_14, SecondNumber=1)  # -> LargerThan, OrEqualTo
gate = StreamGate(Stream=branch_2, Gate=larger_4.LargerThan)  # -> Target0, Target1

# ----
# Proximity
len_4 = Length(Curve=gate.Target1)
sort_10 = SortList(Keys=len_4, ValuesA=gate.Target1)  # -> Keys, reverse(ValuesA)
split_2 = SplitList(List=sort_10.ValuesA, Index=1)  # -> ListA, ListB
crvprox = CurveProximity(CurveA=split_2.ListA, CurveB=split_2.ListB)  # -> PointA, PointB, Distance
ln_4 = Line(StartPoint=crvprox.PointA, EndPoint=crvprox.PointB)

# ----
# Trimming Regions
eval_4 = EvaluateCurve(Curve=reparameterize(ln_4), Parameter=0.5)  # -> Point, Tangent, Angle
xy_3 = XYPlane(Origin=Point(0, 0, 0))
vrot_2 = Rotate(Vector=eval_4.Tangent, Axis=Z_2, Angle=1.570796327)
num_2 = Number(layer_width)
amp_2 = Amplitude(Vector=vrot_2, Amplitude=num_2)
devec = DeconstructVector(Vector=amp_2)  # -> XComponent, YComponent, ZComponent
number_slider_4 = Slider(1.1, range=0..10)
vec = VectorXYZ(XComponent=devec.XComponent, YComponent=devec.YComponent, ZComponent=0)  # -> Vector, Length
curvepoint = PointOnCurve(ln_4, parameter=0.5)
multiplication_2 = Multiplication(A=num_2, B=2)
X = UnitX(Factor=1)
addition = Addition(A=num_2, B=number_slider_4)
addition_2 = Addition(A=multiplication_2, B=number_slider_4)
angle_4 = Angle(VectorA=X, VectorB=vec.Vector, Plane=xy_3)  # -> Angle, Reflex
prot_2 = RotatePlane(Plane=xy_3, Angle=angle_4.Angle)
dom_3 = ConstructDomain(DomainStart=expr("-x", addition), DomainEnd=addition)
dom_4 = ConstructDomain(DomainStart=expr("-x", addition_2), DomainEnd=addition_2)
pl_origin = PlaneOrigin(Base=prot_2, Origin=curvepoint)
rectangle_2 = Rectangle(Plane=pl_origin, XSize=dom_3, YSize=dom_4, Radius=expr("x/2", addition_2))  # -> Rectangle, Length

# ----
# Trim and Connect
trim_10 = TrimWithRegions(Curve=gate.Target1, Regions=rectangle_2.Rectangle, Plane=xy_3)  # -> Inside, Outside

# ---- group: Point at inital Lines
crv_7 = Curve(trim_10.Inside)
join_5 = JoinCurves(Curves=crv_7, Preserve=False)
trim_11 = TrimTree(Tree=join_5, Depth=1)
end_2 = EndPoints(Curve=trim_11)  # -> Start, End
ln_5 = Line(StartPoint=end_2.Start, EndPoint=end_2.End)
curvepoint_2 = PointOnCurve(ln_5, parameter=0.5)
incurve = PointInCurve(Point=graft(curvepoint_2), Curve=rectangle_2.Rectangle)  # -> Relationship, Point
equals_5 = Equality(FirstNumber=incurve.Relationship, SecondNumber=0)  # -> Equality, Inequality
mindex_2 = MemberIndex(Set=equals_5.Equality, Member=False)  # -> Index, Count
lng_15 = ListLength(List=mindex_2.Index)
dup_3 = DuplicateData(Data=graft(curvepoint_2), Number=lng_15, Order=True)
path_2 = ConstructPath(Indices=graft(mindex_2.Index))  # -> flatten(Branch)
tstat_4 = TreeStatistics(Tree=graft(dup_3))  # -> Paths, Length, Count
replace_2 = ReplacePaths(Data=graft(dup_3), Search=tstat_4.Paths, Replace=path_2)

# ---- group: Optional Lines
end_3 = EndPoints(Curve=trim_10.Outside)  # -> Start, End
merge_9 = Merge(Data1=end_3.Start, Data2=end_3.End)  # -> flatten(Result)
lng_16 = ListLength(List=rectangle_2.Rectangle)
crv_cp_4 = CurveClosestPoint(Point=graft(merge_9), Curve=rectangle_2.Rectangle)  # -> Point, Parameter, Distance
series_4 = Series(Start=0, Step=1, Count=lng_16)
sort_11 = SortList(Keys=crv_cp_4.Distance, ValuesA=series_4)  # -> Keys, ValuesA
item_13 = ListItem(List=sort_11.ValuesA, Index=0, Wrap=True)
tstat_5 = TreeStatistics(Tree=graft(merge_9))  # -> Paths, Length, Count
path_3 = ConstructPath(Indices=item_13)  # -> flatten(Branch)
replace_3 = ReplacePaths(Data=graft(merge_9), Search=tstat_5.Paths, Replace=path_3)
alongcrv = SortAlongCurve(Points=replace_3, Curve=graft(rectangle_2.Rectangle))  # -> Points, Indices
pline = PolyLine(Vertices=alongcrv.Points, Closed=True)
explode_6 = Explode(Curve=pline, Recursive=True)  # -> Segments, Vertices
curvepoint_3 = PointOnCurve(explode_6.Segments, parameter=0.5)

# ---- group: Cull inital Lines
cp = ClosestPoint(Point=replace_2, Cloud=curvepoint_3)  # -> ClosestPoint, CPIndex, Distance
cull_i_4 = CullIndex(List=explode_6.Segments, Indices=cp.CPIndex, Wrap=True)

# ----
# Join and Close
dupln_5 = RemoveDuplicateLines(Lines=flatten(cull_i_4), Tolerance=0.01)
len_5 = Length(Curve=dupln_5)
smaller_5 = SmallerThan(FirstNumber=len_5, SecondNumber=expr("x*6", num_2))  # -> SmallerThan, OrEqualTo
cull_9 = CullPattern(List=dupln_5, CullPattern=smaller_5.SmallerThan)

trim_12 = TrimTree(Tree=trim_10.Outside, Depth=1)

merge_10 = Merge(Data1=trim_12, Data2=cull_9)
join_6 = JoinCurves(Curves=flatten(merge_10), Preserve=False)
clscrv_2 = CloseCurve(Curve=join_6, CloseType=0, Bulge=0.5, Tolerance=expr("x*6", num))  # -> Closed, R
tstat_6 = TreeStatistics(Tree=clscrv_2.Closed)  # -> Paths, Length, Count
replace_4 = ReplacePaths(Data=clscrv_2.Closed, Search=tstat_6.Paths, Replace=item_12)

filter_2 = StreamFilter(Gate=larger_4.LargerThan, Stream0=gate.Target0, Stream1=replace_4)
merge_11 = Merge(Data1=loop_start_2.Data_2, Data2=filter_2)
loop_end_2 = LoopEnd(
    port=loop_start_2.port,
    Exit=False,
    Data=simplify(loop_start_2.Data),
    Data_2=merge_11,
    TimeOutVal=0,
    pausedState=False,
    state="Output last")  # -> D0, D1

# ----
# Bake
tstat_7 = TreeStatistics(Tree=loop_end_2.D1)  # -> Paths, Length, Count
dpath = DeconstructPath(Branch=tstat_7.Paths)  # -> flatten(Indices)
concat = Concatenate(FragmentA="ToolPaths::", FragmentB="Layer ", FragmentC=dpath)
bake = Button()
attributes = DefineObjectAttributes(Layer=concat, Color=ColourSwatch(SwatchColor=RGB(224, 224, 224)))
bake_2 = BakeObjects(Geometry=loop_end_2.D1, Attributes=graft(attributes), BakeName="Toolpaths", Bake=bake)

# ---- group: Closed
cls_2 = Closed(Curve=loop_end_2.D1)  # -> Closed, Periodic
clean_3 = CleanTree(RemoveNulls=True, RemoveInvalid=True, RemoveEmpty=False, Tree=flatten(cls_2.Closed))
not = GateNot(A=clean_3)
ma = MassAddition(Input=not)  # -> Result, PartialResults
should_be_0 = Panel(ma.Result)
cull_10 = CullPattern(List=loop_end_2.D1, CullPattern=invert(cls_2.Closed))  # -> simplify(List)
lng_17 = ListLength(List=cull_10)
equals_6 = Equality(FirstNumber=lng_17, SecondNumber=0)  # -> Equality, Inequality
tstat_8 = TreeStatistics(Tree=cull_10)  # -> Paths, Length, Count
cull_11 = CullPattern(List=graft(tstat_8.Paths), CullPattern=equals_6.Inequality)  # -> flatten(List)

# ----
# Check
# Check whether the toolpaths are closed and continuous within the layer. If a few issues occur, they need to be edited manually in Rhino. It can happen that the last layer (mainly when the contour cuts the geometry only partially) is problematic. When the aim is prototyping, it might not be a problem to leave out the last layer. This needs to be considered for every case individually.
viewer_3 = ParamViewer(loop_end_2.D1)
check_in_which_layers_the_issues_occur = Panel(cull_11)

# ---- group: Continuous
lng_18 = ListLength(List=loop_end_2.D1)
equals_7 = Equality(FirstNumber=lng_18, SecondNumber=1)  # -> Equality, Inequality
not_2 = GateNot(A=flatten(equals_7.Equality))
tstat_9 = TreeStatistics(Tree=lng_18)  # -> Paths, Length, Count
ma_2 = MassAddition(Input=not_2)  # -> Result, PartialResults
cull_12 = CullPattern(List=graft(tstat_9.Paths), CullPattern=equals_7.Inequality)  # -> flatten(List)
should_be_0_2 = Panel(ma_2.Result)
check_in_which_layers_the_issues_occur_2 = Panel(cull_12)

# ---- group: Self-Intersection
# There are some issues here. The self-intersections are on a scale on which it is neglectible for the printing, but it should be checked in the script where these issues emerge.
cx = CurveSelf(Curve=loop_end_2.D1)  # -> Points, Params
lng_19 = ListLength(List=cx.Points)
equals_8 = Equality(FirstNumber=lng_19, SecondNumber=0)  # -> Equality, Inequality
tstat_10 = TreeStatistics(Tree=cx.Params)  # -> Paths, Length, Count
cull_13 = CullPattern(List=graft(tstat_10.Paths), CullPattern=equals_8.Inequality)  # -> flatten(List)
check_in_which_layers_the_issues_occur_3 = Panel(cull_13)

# ==== cluster Cluster
T = ClusterInput()
L = ClusterInput()
i = ClusterInput()
I = ClusterInput()
tstat = TreeStatistics(Tree=simplify(T))  # -> Paths, Length, Count
item = ListItem(List=L, Index=i, Wrap=True)  # -> graft(Item)
path = ConstructPath(Indices=graft(I))  # -> flatten(Branch)
tstat_2 = TreeStatistics(Tree=item)  # -> Paths, Length, Count
item_2 = ListItem(List=tstat.Paths, Index=-1, Wrap=True)
replace = ReplacePaths(Data=item, Search=tstat_2.Paths, Replace=path)
dpath = DeconstructPath(Branch=item_2)
tstat_3 = TreeStatistics(Tree=replace)  # -> Paths, Length, Count
item_3 = ListItem(List=dpath, Index=0, Wrap=True)
lng = ListLength(List=tstat_3.Paths)
series = Series(Start=expr("x+1", item_3), Step=1, Count=lng)
path_2 = ConstructPath(Indices=graft(series))  # -> flatten(Branch)
replace_2 = ReplacePaths(Data=replace, Search=tstat_3.Paths, Replace=path_2)
D = ClusterOutput(replace_2)
